# Dynamo graph Detalhe dos Ambientes 2D e 3D-R01_script.dyn "Detalhe dos Ambientes 2D e 3D-R00_script" (Dynamo 2.13.1.3887)
# author: BIM Coder
# packages: archi-lab.net 2024.217.1024

boolean = BoolSelector(false)
formulário_inicial = Python(IN[0]=boolean)  # IronPython2
# ---------- formulário_inicial.python (55 lines) ----------
#! python3

import clr
clr.AddReference('System.Windows.Forms')
clr.AddReference('System.Drawing')

from System.Windows.Forms import Application, Form, Label, ComboBox, Button, FormStartPosition, ComboBoxStyle
from System.Drawing import Point, Size, Color

class MyForm(Form):
    def __init__(self):
        self.Text = "Configuração de Detalhes"
        self.Size = Size(280, 160)
        
        self.StartPosition = FormStartPosition.CenterScreen
        self.MaximizeBox = False
        self.MinimizeBox = False
        self.ShowIcon = False

        # Configuração do tema Dark
        self.BackColor = Color.FromArgb(45, 45, 48)
        self.ForeColor = Color.White

        # Label para pergunta
        self.label_question = Label()
        self.label_question.Text = "Criar vários detalhes?"
        self.label_question.Size = Size(200, 30) 
        self.label_question.Location = Point((self.ClientSize.Width - self.label_question.Width) // 2, 20)
        self.Controls.Add(self.label_question)

        # ComboBox para resposta
        self.combobox_details = ComboBox()
        self.combobox_details.Items.Add("SIM")
        self.combobox_details.Items.Add("NÃO")
        self.combobox_details.SelectedIndex = 0
        self.combobox_details.DropDownStyle = ComboBoxStyle.DropDownList
        self.combobox_details.Size = Size(100, 30)
        self.combobox_details.Location = Point((self.ClientSize.Width - self.combobox_details.Width) // 2, 50)
        self.Controls.Add(self.combobox_details)

        # Botão OK
        self.btn_ok = Button()
        self.btn_ok.Text = "OK"
        self.btn_ok.Location = Point((self.ClientSize.Width - self.btn_ok.Width) // 2, 90)
        self.btn_ok.Click += self.on_ok
        self.Controls.Add(self.btn_ok)

    def on_ok(self, sender, event):
        global create_multiple_details
        create_multiple_details = self.combobox_details.SelectedItem
        self.Close()

form = MyForm()
Application.Run(form)
OUT = create_multiple_details
# ----------------------------------------

# group: CAMPOS PERSONALIZÁVEIS
# Parâmetro do número de detalhe
# note: Altere este campo caso o nome do parâmetro da região seja alterado.
parâmetro = StringInput("p.NÚMERO.DETALHE")

# group: CAMPOS PERSONALIZÁVEIS
# Nomes dos View Templates principais
view_template_plantas = StringInput("DOC - DETALHE")
# note: Altere estes campos caso o nome dos templates principais sejam alterados.
# Desta forma, eles sempres aparecerão em primeiro na lista de templates.
view_template_3d = StringInput("DOC - 3D")

formulário_principal = Python(IN[0]=formulário_inicial, IN[1]=parâmetro, IN[2]=view_template_plantas, IN[3]=view_template_3d)  # IronPython2
# ---------- formulário_principal.python (472 lines) ----------
import clr
clr.AddReference('System.Windows.Forms')
clr.AddReference('System.Drawing')

from System.Windows.Forms import Application, Form, Label, TextBox, Button, ComboBox, ComboBoxStyle, CheckBox, FormStartPosition, KeyPressEventArgs
from System.Drawing import Point, Size, Color

from System.Collections.Generic import List
from System import Array

# Referências necessárias para a API do Revit
clr.AddReference('RevitAPI')
clr.AddReference('RevitServices')
clr.AddReference('RevitAPIUI')
import Autodesk 
from Autodesk.Revit.UI import TaskDialog
from Autodesk.Revit.DB import BuiltInCategory,ElementId, UnitUtils, UnitTypeId, PlanViewPlane, FilteredElementCollector, View, ViewType
from Autodesk.Revit.UI.Selection import ObjectType
from RevitServices.Persistence import DocumentManager
from System.Collections.Generic import List

# Obtendo o documento ativo
doc = DocumentManager.Instance.CurrentDBDocument

# Parâmetro de entrada
varios_detalhes = IN[0]
parametro = IN[1] 

class MyForm1(Form):
    def __init__(self): 
        self.Text = 'Criar Detalhes 2D e 3D'
        self.Size = Size(400, 440)
        self.StartPosition = FormStartPosition.CenterScreen
        self.BackColor = Color.FromArgb(45, 45, 48)  # Cor de fundo escura
        self.ShowIcon = False  # Esconder o ícone 
        
        self.dropdown_label = Label()
        self.dropdown_label.Text = 'Duplicar como:'
        self.dropdown_label.Location = Point(10, 20)
        self.dropdown_label.Size = Size(150, 20) 
        self.dropdown_label.ForeColor = Color.White  # Cor do texto branca
        self.Controls.Add(self.dropdown_label)
        
        self.dropdown = ComboBox()
        self.dropdown.Items.AddRange(Array[str](['WithDetailing', 'Duplicate', 'AsDependent']))
        self.dropdown.Location = Point(160, 20)
        self.dropdown.Size = Size(200, 20)
        self.dropdown.DropDownStyle = ComboBoxStyle.DropDownList
        self.dropdown.BackColor = Color.FromArgb(30, 30, 30)  # Fundo mais escuro para dropdown
        self.dropdown.ForeColor = Color.White  # Cor do texto branca
        self.dropdown.SelectedItem = 'Duplicate'  # Seleção padrão
        self.Controls.Add(self.dropdown)
        
        # Adicionar DropDownList para templates de plantas de piso
        self.floor_template_label = Label()
        self.floor_template_label.Text = 'Template Planta de Piso:'
        self.floor_template_label.Location = Point(10, 60)
        self.floor_template_label.Size = Size(150, 20)
        self.floor_template_label.ForeColor = Color.White  # Cor do texto branca
        self.Controls.Add(self.floor_template_label)

        self.floor_template_dropdown = ComboBox()
        self.floor_template_dropdown.Location = Point(160, 60)
        self.floor_template_dropdown.Size = Size(200, 20)
        self.floor_template_dropdown.DropDownStyle = ComboBoxStyle.DropDownList
        self.floor_template_dropdown.BackColor = Color.FromArgb(30, 30, 30)  # Fundo mais escuro para dropdown
        self.floor_template_dropdown.ForeColor = Color.White  # Cor do texto branca
        self.Controls.Add(self.floor_template_dropdown)
        
        # Adicionar DropDownList para templates de vistas 3D
        self.threeD_template_label = Label()
        self.threeD_template_label.Text = 'Template Vista 3D:' 
        self.threeD_template_label.Location = Point(10, 100)
        self.threeD_template_label.Size = Size(150, 20)
        self.threeD_template_label.ForeColor = Color.White  # Cor do texto branca
        self.Controls.Add(self.threeD_template_label)

        self.threeD_template_dropdown = ComboBox()
        self.threeD_template_dropdown.Location = Point(160, 100)
        self.threeD_template_dropdown.Size = Size(200, 20)
        self.threeD_template_dropdown.DropDownStyle = ComboBoxStyle.DropDownList
        self.threeD_template_dropdown.BackColor = Color.FromArgb(30, 30, 30)  # Fundo mais escuro para dropdown
        self.threeD_template_dropdown.ForeColor = Color.White  # Cor do texto branca
        self.Controls.Add(self.threeD_template_dropdown)

        # Restante do código...
        self.checkbox_label = Label()
        self.checkbox_label.Text = 'Criar Planta de Piso?:'
        self.checkbox_label.Location = Point(10, 140)
        self.checkbox_label.Size = Size(120, 20)
        self.checkbox_label.ForeColor = Color.White  # Cor do texto branca
        self.Controls.Add(self.checkbox_label)
        
        self.checkbox = CheckBox()
        self.checkbox.Text = 'Sim'
        self.checkbox.Location = Point(160, 140)
        self.checkbox.Size = Size(150, 20)
        self.checkbox.BackColor = Color.FromArgb(45, 45, 48)  # Mesma cor do fundo do formulário
        self.checkbox.ForeColor = Color.White  # Cor do texto branca
        self.checkbox.Checked = True  # Caixa marcada por padrão
        self.Controls.Add(self.checkbox)
        
        self.checkbox3d_label = Label()
        self.checkbox3d_label.Text = 'Criar Vista 3D?:'
        self.checkbox3d_label.Location = Point(10, 180)
        self.checkbox3d_label.Size = Size(100, 20)
        self.checkbox3d_label.ForeColor = Color.White  # Cor do texto branca
        self.Controls.Add(self.checkbox3d_label)
        
        self.checkbox3d = CheckBox()
        self.checkbox3d.Text = 'Sim'
        self.checkbox3d.Location = Point(160, 180)
        self.checkbox3d.Size = Size(150, 20)
        self.checkbox3d.BackColor = Color.FromArgb(45, 45, 48)  # Mesma cor do fundo do formulário
        self.checkbox3d.ForeColor = Color.White  # Cor do texto branca
        self.checkbox3d.Checked = True  # Caixa marcada por padrão
        self.Controls.Add(self.checkbox3d)
        
        self.pick_button = Button()
        self.pick_button.Text = 'Selecionar regiões'
        self.pick_button.Location = Point(120, 220)
        self.pick_button.Size = Size(160, 30)  # Tamanho aumentado para caber o texto
        self.pick_button.BackColor = Color.Red  # Fundo vermelho do botão
        self.pick_button.ForeColor = Color.White  # Cor do texto branca
        self.pick_button.Click += self.pick_button_click
        self.Controls.Add(self.pick_button)

        self.button = Button()
        self.button.Text = 'OK'
        self.button.Location = Point(160, 260)
        self.button.Size = Size(80, 30)  # Tamanho aumentado para caber o texto
        self.button.BackColor = Color.FromArgb(51, 153, 255)  # Fundo azul do botão
        self.button.ForeColor = Color.White  # Cor do texto branca
        self.button.Click += self.button_click
        self.Controls.Add(self.button)
        
        # Informação da empresa
        self.company_info = Label()
        self.company_info.Text = 'Versão 1.0\nBIM Coder | Première Engenharia\nBy: Fellipe Caetano\nIG: @bimcoder YT: _bimcoder\ncontato@bimcoder.net'  
        self.company_info.Location = Point(10, 310)
        self.company_info.Size = Size(280, 80)
        self.company_info.ForeColor = Color.White  # Cor do texto branca
        self.Controls.Add(self.company_info)
        
        # Preencher os dropdowns com os templates de vistas
        self.populate_templates()
    
    def populate_templates(self):
        doc = DocumentManager.Instance.CurrentDBDocument
        
        # Entradas - Nomes dos templates prioritários
        nome_template_floor = IN[2]
        nome_template_threeD = IN[3]
        
        floor_plan_templates, threeD_templates = get_view_templates(doc, nome_template_floor, nome_template_threeD)
        
        self.floor_template_dropdown.Items.AddRange(Array[str](floor_plan_templates))
        try: self.floor_template_dropdown.SelectedIndex = 0
        except: pass
        
        self.threeD_template_dropdown.Items.AddRange(Array[str](threeD_templates))
        try: self.threeD_template_dropdown.SelectedIndex = 0
        except: pass
    
    def height_textbox_keypress(self, sender, event):
        if not event.KeyChar.isdigit() and event.KeyChar != '\b':
            event.Handled = True
    
    def button_click(self, sender, event):
        global detail_values
        global duplicate_option
        global is_floor_plan
        global is_3d_view
        global height_3d
        global selected_elements
        global selected_floor_template
        global selected_3D_template
        
        detail_values = [elem.LookupParameter(parametro).AsString() for elem in selected_elements]
        duplicate_option = self.dropdown.SelectedItem
        is_floor_plan = self.checkbox.Checked
        is_3d_view = self.checkbox3d.Checked
        selected_floor_template = self.floor_template_dropdown.SelectedItem
        selected_3D_template = self.threeD_template_dropdown.SelectedItem
        try:
            height_3d = GetTopBottomViewRange(doc.ActiveView)
        except ValueError:
            height_3d = None
        self.Close()

    def pick_button_click(self, sender, event):
        self.Hide()
        doc = DocumentManager.Instance.CurrentDBDocument
        uidoc = DocumentManager.Instance.CurrentUIApplication.ActiveUIDocument
        global selected_elements
        try:
            references = uidoc.Selection.PickObjects(ObjectType.Element, "Selecione elementos")
            selected_elements = []
            missing_name_elements = []
            for reference in references:
                element = doc.GetElement(reference)
                
                if element.Category.Id.IntegerValue == int(BuiltInCategory.OST_DetailComponents):
                    param_value = element.LookupParameter(parametro)
                    if param_value:
                        param_value = param_value.AsString()
                        if param_value and param_value != "":
                            selected_elements.append(element)
                        else:
                            missing_name_elements.append(element)
                    else:
                        missing_name_elements.append(element)
            
            if missing_name_elements:
                missing_ids = List[ElementId]([elem.Id for elem in missing_name_elements])
                uidoc.Selection.SetElementIds(missing_ids)
                TaskDialog.Show("Atenção", "As Regiões que estão selecionadas não possuem nome definido! Você pode continuar a operação ou cancelar e tentar novamente")
                
            self.pick_button.BackColor = Color.Green  # Mudar a cor do botão para verde
            self.pick_button.Text = 'Regiões selecionadas!' 
        except Exception as e:
            selected_elements = []
            TaskDialog.Show('Erro', str(e))
        self.Show()
        self.StartPosition = FormStartPosition.CenterScreen
        self.BringToFront()

        
class MyForm2(Form):
    def __init__(self): 
        self.Text = 'Criar Detalhes 2D e 3D'
        self.Size = Size(400, 480)
        self.StartPosition = FormStartPosition.CenterScreen
        self.BackColor = Color.FromArgb(45, 45, 48)  # Cor de fundo escura
        self.ShowIcon = False  # Esconder o ícone
        
        # Adicionar campo de texto para "Nome do detalhe"
        self.name_label = Label()
        self.name_label.Text = 'Nome do detalhe:'
        self.name_label.Location = Point(10, 20)
        self.name_label.Size = Size(150, 20)
        self.name_label.ForeColor = Color.White  # Cor do texto branca
        self.Controls.Add(self.name_label)
        
        self.name_textbox = TextBox()
        self.name_textbox.Location = Point(160, 20)
        self.name_textbox.Size = Size(200, 20)
        self.Controls.Add(self.name_textbox)

        self.dropdown_label = Label()
        self.dropdown_label.Text = 'Duplicar como:'
        self.dropdown_label.Location = Point(10, 60)
        self.dropdown_label.Size = Size(150, 20)
        self.dropdown_label.ForeColor = Color.White  # Cor do texto branca
        self.Controls.Add(self.dropdown_label)
        
        self.dropdown = ComboBox()
        self.dropdown.Items.AddRange(Array[str](['WithDetailing', 'Duplicate', 'AsDependent']))
        self.dropdown.Location = Point(160, 60)
        self.dropdown.Size = Size(200, 20)
        self.Controls.Add(self.dropdown)
        self.dropdown.Location = Point(160, 60)
        self.dropdown.Size = Size(200, 20)
        self.dropdown.DropDownStyle = ComboBoxStyle.DropDownList
        self.dropdown.BackColor = Color.FromArgb(30, 30, 30)  # Fundo mais escuro para dropdown
        self.dropdown.ForeColor = Color.White  # Cor do texto branca
        self.dropdown.SelectedItem = 'Duplicate'  # Seleção padrão
        self.Controls.Add(self.dropdown)
        
        # Adicionar DropDownList para templates de plantas de piso
        self.floor_template_label = Label()
        self.floor_template_label.Text = 'Template Planta de Piso:'
        self.floor_template_label.Location = Point(10, 100)
        self.floor_template_label.Size = Size(150, 20)
        self.floor_template_label.ForeColor = Color.White  # Cor do texto branca
        self.Controls.Add(self.floor_template_label)

        self.floor_template_dropdown = ComboBox()
        self.floor_template_dropdown.Location = Point(160, 100)
        self.floor_template_dropdown.Size = Size(200, 20)
        self.floor_template_dropdown.DropDownStyle = ComboBoxStyle.DropDownList
        self.floor_template_dropdown.BackColor = Color.FromArgb(30, 30, 30)  # Fundo mais escuro para dropdown
        self.floor_template_dropdown.ForeColor = Color.White  # Cor do texto branca
        self.Controls.Add(self.floor_template_dropdown)
        
        # Adicionar DropDownList para templates de vistas 3D
        self.threeD_template_label = Label()
        self.threeD_template_label.Text = 'Template Vista 3D:'
        self.threeD_template_label.Location = Point(10, 140)
        self.threeD_template_label.Size = Size(150, 20)
        self.threeD_template_label.ForeColor = Color.White  # Cor do texto branca
        self.Controls.Add(self.threeD_template_label)

        self.threeD_template_dropdown = ComboBox()
        self.threeD_template_dropdown.Location = Point(160, 140)
        self.threeD_template_dropdown.Size = Size(200, 20)
        self.threeD_template_dropdown.DropDownStyle = ComboBoxStyle.DropDownList
        self.threeD_template_dropdown.BackColor = Color.FromArgb(30, 30, 30)  # Fundo mais escuro para dropdown
        self.threeD_template_dropdown.ForeColor = Color.White  # Cor do texto branca
        self.Controls.Add(self.threeD_template_dropdown)

        # Restante do código...
        self.checkbox_label = Label()
        self.checkbox_label.Text = 'Criar Planta de Piso?:'
        self.checkbox_label.Location = Point(10, 180)
        self.checkbox_label.Size = Size(120, 20)
        self.checkbox_label.ForeColor = Color.White  # Cor do texto branca
        self.Controls.Add(self.checkbox_label)
        
        self.checkbox = CheckBox()
        self.checkbox.Text = 'Sim'
        self.checkbox.Location = Point(160, 180)
        self.checkbox.Size = Size(150, 20)
        self.checkbox.BackColor = Color.FromArgb(45, 45, 48)  # Mesma cor do fundo do formulário
        self.checkbox.ForeColor = Color.White  # Cor do texto branca
        self.checkbox.Checked = True  # Caixa marcada por padrão
        self.Controls.Add(self.checkbox)
        
        self.checkbox3d_label = Label()
        self.checkbox3d_label.Text = 'Criar Vista 3D?:'
        self.checkbox3d_label.Location = Point(10, 220)
        self.checkbox3d_label.Size = Size(100, 20)
        self.checkbox3d_label.ForeColor = Color.White  # Cor do texto branca
        self.Controls.Add(self.checkbox3d_label)
        
        self.checkbox3d = CheckBox()
        self.checkbox3d.Text = 'Sim'
        self.checkbox3d.Location = Point(160, 220)
        self.checkbox3d.Size = Size(150, 20)
        self.checkbox3d.BackColor = Color.FromArgb(45, 45, 48)  # Mesma cor do fundo do formulário
        self.checkbox3d.ForeColor = Color.White  # Cor do texto branca
        self.checkbox3d.Checked = True  # Caixa marcada por padrão
        self.Controls.Add(self.checkbox3d)
        
        self.pick_button = Button()
        self.pick_button.Text = 'Selecionar região'
        self.pick_button.Location = Point(120, 260)
        self.pick_button.Size = Size(160, 30)  # Tamanho aumentado para caber o texto
        self.pick_button.BackColor = Color.Red  # Fundo vermelho do botão
        self.pick_button.ForeColor = Color.White  # Cor do texto branca
        self.pick_button.Click += self.pick_button_click
        self.Controls.Add(self.pick_button)

        self.button = Button()
        self.button.Text = 'OK'
        self.button.Location = Point(160, 300)
        self.button.Size = Size(80, 30)  # Tamanho aumentado para caber o texto
        self.button.BackColor = Color.FromArgb(51, 153, 255)  # Fundo azul do botão
        self.button.ForeColor = Color.White  # Cor do texto branca
        self.button.Click += self.button_click
        self.Controls.Add(self.button)
        
        # Informação da empresa
        self.company_info = Label()
        self.company_info.Text = 'Versão 1.0\nBIM Coder | Première Engenharia\nBy: Fellipe Caetano\nIG: @bimcoder YT: _bimcoder\ncontato@bimcoder.net'  
        self.company_info.Location = Point(10, 350)
        self.company_info.Size = Size(380, 80)
        self.company_info.ForeColor = Color.White  # Cor do texto branca
        self.Controls.Add(self.company_info)
        
        # Preencher os dropdowns com os templates de vistas
        self.populate_templates()
    
    def populate_templates(self):
        doc = DocumentManager.Instance.CurrentDBDocument
        
        # Entradas - Nomes dos templates prioritários
        nome_template_floor = IN[2]
        nome_template_threeD = IN[3]
        
        floor_plan_templates, threeD_templates = get_view_templates(doc, nome_template_floor, nome_template_threeD)
        
        self.floor_template_dropdown.Items.AddRange(Array[str](floor_plan_templates))
        
        try:
        	self.floor_template_dropdown.SelectedIndex = 0
        except:
			pass        
                  
        self.threeD_template_dropdown.Items.AddRange(Array[str](threeD_templates))
        
        try:
        	self.threeD_template_dropdown.SelectedIndex = 0
        	
       	except: 
       		pass 
    
    def height_textbox_keypress(self, sender, event):
        if not event.KeyChar.isdigit() and event.KeyChar != '\b':
            event.Handled = True
    
    def button_click(self, sender, event):
        global detail_values
        global duplicate_option
        global is_floor_plan
        global is_3d_view
        global height_3d
        global selected_elements
        global selected_floor_template 
        global selected_3D_template
        global detail_name
        
        detail_name = self.name_textbox.Text
        detail_values = [elem.LookupParameter(parametro).AsString() for elem in selected_elements]
        duplicate_option = self.dropdown.SelectedItem
        is_floor_plan = self.checkbox.Checked
        is_3d_view = self.checkbox3d.Checked
        selected_floor_template = self.floor_template_dropdown.SelectedItem
        selected_3D_template = self.threeD_template_dropdown.SelectedItem
        try:
            height_3d = GetTopBottomViewRange(doc.ActiveView)
        except ValueError:
            height_3d = None
        self.Close()

    def pick_button_click(self, sender, event):
        self.Hide()
        doc = DocumentManager.Instance.CurrentDBDocument
        uidoc = DocumentManager.Instance.CurrentUIApplication.ActiveUIDocument
        global selected_elements
        try:
            reference = uidoc.Selection.PickObject(ObjectType.Element, "Selecione um elemento")
            selected_elements = []
            missing_name_elements = []
            element = doc.GetElement(reference)
                
            if element.Category.Id.IntegerValue == int(BuiltInCategory.OST_DetailComponents):
                selected_elements.append(element)
            else:
                TaskDialog.Show("Atenção","Por favor, selecione uma Região!")           
           
                
            self.pick_button.BackColor = Color.Green  # Mudar a cor do botão para verde
            self.pick_button.Text = 'Região selecionada!' 
        except Exception as e:
            selected_elements = []
            TaskDialog.Show('Erro', str(e))
        self.Show()
        self.StartPosition = FormStartPosition.CenterScreen
        self.BringToFront()



def GetTopBottomViewRange(view):
    top = UnitUtils.ConvertFromInternalUnits(view.GetViewRange().GetOffset(PlanViewPlane.TopClipPlane),UnitTypeId.Centimeters)
    
    bottom = UnitUtils.ConvertFromInternalUnits(view.GetViewRange().GetOffset(PlanViewPlane.BottomClipPlane),UnitTypeId.Centimeters)
    
    return top, bottom
    
def get_view_templates(doc, nome_template_floor, nome_template_threeD):
    collector = FilteredElementCollector(doc).OfClass(View)  
    # Filtrar templates de planta de piso e 3D
    floor_plan_templates = [v for v in collector if v.IsTemplate and v.ViewType == ViewType.FloorPlan]
    threeD_templates = [v for v in collector if v.IsTemplate and v.ViewType == ViewType.ThreeD]
    
    # Ordenar as listas colocando os templates com os nomes especificados na primeira posição, se existirem
    floor_plan_templates_sorted = sorted(floor_plan_templates, key=lambda x: (x.Name != nome_template_floor, x.Name))
    threeD_templates_sorted = sorted(threeD_templates, key=lambda x: (x.Name != nome_template_threeD, x.Name))
    
    return [e.Name for e in floor_plan_templates_sorted], [e.Name for e in threeD_templates_sorted]

# Inicializar e executar o formulário
if varios_detalhes=="SIM":
    form = MyForm1()
    Application.Run(form)  
    OUT = (detail_values, duplicate_option, is_floor_plan, is_3d_view, height_3d,  selected_elements, selected_floor_template,selected_3D_template )
else:
    form = MyForm2()
    Application.Run(form)
    
    OUT = (detail_name, duplicate_option, is_floor_plan, is_3d_view, height_3d, selected_elements,selected_floor_template,selected_3D_template )
# ----------------------------------------
code_block = CodeBlock(IN=formulário_principal)
# ---------- code_block.designscript (8 lines) ----------
nomeDaVista = IN[0];
duplicateAs = IN[1];
floorPlan = IN[2];
view3D = IN[3];
height = IN[4];
filledRegion = IN[5];
floorPlan_template = IN[6];
three3D_template = IN[7];
# ----------------------------------------

# group: Modificações na Vista -> CropBox, Nome e View Template
cropBoxVisible = archilab.Revit.Views.Views.CropBoxVisible()  # unwired: view
obtém_as_linhas_da_filledregion = Python(IN[0]=code_block.filledRegion)  # IronPython2
# ---------- obtém_as_linhas_da_filledregion.python (51 lines) ----------
# Importando as bibliotecas necessárias do Revit
import clr
clr.AddReference('RevitServices')
clr.AddReference('RevitAPI')
clr.AddReference('RevitNodes')
clr.AddReference('ProtoGeometry')
import Revit
clr.ImportExtensions(Revit.Elements)
clr.ImportExtensions(Revit.GeometryConversion)

from Autodesk.DesignScript.Geometry import *
from RevitServices.Persistence import DocumentManager
from RevitServices.Transactions import TransactionManager
from Autodesk.Revit.DB import *
from Autodesk.Revit.DB.Architecture import *
from Autodesk.Revit.DB.Structure import *
from Autodesk.Revit.DB.Mechanical import *

# Obtendo o documento atual
doc = DocumentManager.Instance.CurrentDBDocument

# Função para obter as linhas da FilledRegion
def get_filled_region_lines(filled_region):
    # Inicializando uma lista para armazenar as linhas
    lines = []
    
    # Obtendo as bordas da FilledRegion
    boundaries = filled_region.GetBoundaries()
    
    # Iterando sobre cada boundary
    for boundary in boundaries:
        # Iterando sobre cada curva no boundary
        for curve in boundary:
            lines.append(curve.ToProtoType())
    
    return lines

# Verifica se a entrada é uma lista ou um único elemento
if isinstance(IN[0], list):
    filled_regions = [UnwrapElement(x) for x in IN[0]]
else:
    filled_regions = [UnwrapElement(IN[0])]

# Aplicando a função a todos os elementos na lista
all_lines = []
for region in filled_regions:
    lines = get_filled_region_lines(region)
    all_lines.append(lines)

# Saída do script
OUT = all_lines if len(all_lines) > 1 else all_lines[0]
# ----------------------------------------
setCropBoxByCurves = archilab.Revit.Views.Views.SetCropBoxByCurves(curves=obtém_as_linhas_da_filledregion)  # unwired: view
function_compose = ComposeFunctions(function0=cropBoxVisible, function1=setCropBoxByCurves)

# group: Função vazia
function_compose_2 = ComposeFunctions()  # unwired: function0, function1

# group: Duplicar a Vista
duplicate = archilab.Revit.Views.Views.Duplicate(options=code_block.duplicateAs)  # unwired: view
current = Document.Current()
activeView = Document.ActiveView(document=current)
count = List.Count(list=code_block.nomeDaVista)
ofRepeatedItem = List.OfRepeatedItem(item=activeView, amount=count)
function_apply = ApplyFunction(function=duplicate, argument0=ofRepeatedItem)

# group: Aplicar funções - Criar planta de piso
IF = Python(IN[0]=code_block.floorPlan, IN[1]=function_compose, IN[2]=function_compose_2)  # IronPython2
# ---------- IF.python (4 lines) ----------
if IN[0]:
	OUT = IN[1]
else:
	OUT = IN[2]
# ----------------------------------------
function_apply_2 = ApplyFunction(function=IF, argument0=function_apply)

inserir_vt_e_renomear_vista = Python(IN[0]=code_block.floorPlan, IN[1]=function_apply_2, IN[2]=code_block.floorPlan_template, IN[3]=code_block.nomeDaVista)  # IronPython2
# ---------- inserir_vt_e_renomear_vista.python (53 lines) ----------
import clr
clr.AddReference('RevitAPI')
from Autodesk.Revit.DB import FilteredElementCollector, View, BuiltInParameter

clr.AddReference('RevitServices')
import RevitServices
from RevitServices.Persistence import DocumentManager
from RevitServices.Transactions import TransactionManager

# Entradas do Dynamo
toggle = IN[0]
views = IN[1] if isinstance(IN[1], list) else [IN[1]]
view_template_name = IN[2]
view_names = IN[3] if isinstance(IN[3], list) else [IN[3]]
result = []

# Documento do Revit
doc = DocumentManager.Instance.CurrentDBDocument

# Função para obter o template de visualização pelo nome
def get_view_template_by_name(doc, template_name):
    collector = FilteredElementCollector(doc).OfClass(View)
    for view in collector:
        if view.IsTemplate and view.Name == template_name:
            return view
    return None

if toggle:
    # Obter o template de visualização
    view_template = get_view_template_by_name(doc, view_template_name)
    
    # Iniciar transação
    TransactionManager.Instance.EnsureInTransaction(doc)
    
    # Aplicar o template em cada vista
    i = 0
    for v in views:    
        view = UnwrapElement(v)
        if view_template != None: view.ViewTemplateId = view_template.Id        
        view_name = view.get_Parameter(BuiltInParameter.VIEW_NAME)
        view_name.Set(view_names[i])
        result.append(view)
        i+=1
    
    # Finalizar transação
    TransactionManager.Instance.TransactionTaskDone()
    
    # Ordenar o resultado pelo nome da vista
    result.sort(key=lambda v: v.get_Parameter(BuiltInParameter.VIEW_NAME).AsString())
    
    # Saída 
    OUT = result
     
# ----------------------------------------

# group: Obter a BoundingBox da FilledRegion
byJoinedCurves = PolyCurve.ByJoinedCurves(curves=obtém_as_linhas_da_filledregion)
byGeometry = BoundingBox.ByGeometry(geom=byJoinedCurves@L1)

# group: Obter a linha da FilledRegion de maior comprimento
length = Curve.Length(curve=obtém_as_linhas_da_filledregion)
sortByKey = List.SortByKey(list=obtém_as_linhas_da_filledregion@L2, keys=length@L2)
lastItem = List.LastItem(list=sortByKey.sortedList)

# group: Normal da linha de maior comprimento
code_block_2 = CodeBlock { 0.5; }
normalAtParameter = Curve.NormalAtParameter(curve=lastItem, param=code_block_2)

# group: Criar a Vista 3D
view3d_by_boundingbox = Python(IN[0]=code_block.view3D, IN[1]=code_block.nomeDaVista, IN[2]=byGeometry, IN[3]=code_block.height, IN[4]=normalAtParameter, IN[5]=code_block.three3D_template)  # IronPython2
# ---------- view3d_by_boundingbox.python (115 lines) ----------
import clr
import sys
import System
from System.Collections.Generic import *

clr.AddReference('ProtoGeometry')
from Autodesk.DesignScript.Geometry import *

clr.AddReference('RevitNodes')
import Revit
clr.ImportExtensions(Revit.Elements)
clr.ImportExtensions(Revit.GeometryConversion)

clr.AddReference("RevitServices")
import RevitServices
from RevitServices.Persistence import DocumentManager
from RevitServices.Transactions import TransactionManager

clr.AddReference('RevitAPI')
clr.AddReference('RevitAPIUI')
import Autodesk
from Autodesk.Revit.DB import *
from Autodesk.Revit.UI import *

import math 

doc = DocumentManager.Instance.CurrentDBDocument
uiapp = DocumentManager.Instance.CurrentUIApplication
app = uiapp.Application
uidoc = uiapp.ActiveUIDocument

def toList(x):
    if isinstance(x, list):
        return x
    else:
        return [x]
        
# Função para obter o template de visualização pelo nome
def get_view_template_by_name(doc, template_name):
    collector = FilteredElementCollector(doc).OfClass(View)
    for view in collector:
        if view.IsTemplate and view.Name == template_name:
            return view.Id       

toggle = IN[0]
viewNames = toList(IN[1])
bbBoxes = toList(IN[2])
height = IN[3]
normals = IN[4]
view_template = IN[5]

if toggle:
    # Obter o ViewFamilyType de 3DView
    collector = FilteredElementCollector(doc).OfClass(ViewFamilyType)
    for i in collector:
        viewFamily = i.ViewFamily
        if viewFamily == ViewFamily.ThreeDimensional:
            viewFamilyType = i
    
    # Criar as vistas 3D a partir das BB e dos nomes
    warning = []
    newViews = []
    for viewName, bbBox,normal in zip(viewNames, bbBoxes,normals):
        bb = UnwrapElement(bbBox)
        bbMax = bb.MaxPoint.ToRevitType()
        bbMin = bb.MinPoint.ToRevitType()
        newBB = BoundingBoxXYZ()
        
        bbMin_X = bbMin.X
        bbMin_Y = bbMin.Y
        bbMin_Z = bbMin.Z + UnitUtils.ConvertToInternalUnits(height[1], UnitTypeId.Centimeters) 
        newBBmin = XYZ(bbMin_X, bbMin_Y, bbMin_Z)
        
        bbMax_X = bbMax.X
        bbMax_Y = bbMax.Y
        bbMax_Z = bbMax.Z + UnitUtils.ConvertToInternalUnits(height[0], UnitTypeId.Centimeters)
        newBBmax = XYZ(bbMax_X, bbMax_Y, bbMax_Z)
        
        newBB.Max = newBBmax
        newBB.Min = newBBmin 
        
        # Rotacionar a SectionBox para coincidir com o detalhe
        norm = normal.ToRevitType()
        boxNormal = newBB.Transform.BasisX.Normalize()
        angle = norm.AngleTo(boxNormal)
        axis = XYZ(0, 0, 1.0)
        origin = XYZ(newBB.Min.X + (newBB.Max.X - newBB.Min.X) / 2, newBB.Min.Y + (newBB.Max.Y - newBB.Min.Y) / 2, 0.0)
        
        if norm.Y * boxNormal.X < 0:
            rotate = Transform.CreateRotationAtPoint(axis, math.pi / 2 - angle, origin)
        else:
            rotate = Transform.CreateRotationAtPoint(axis, angle, origin)
        
        newBB.Transform = newBB.Transform.Multiply(rotate)
        
        try:
            TransactionManager.Instance.EnsureInTransaction(doc)
            newView = View3D.CreateIsometric(doc, viewFamilyType.Id)
            newView.Name = viewName
            newView.SetSectionBox(newBB)
            if view_template !=None: newView.ViewTemplateId = get_view_template_by_name(doc,view_template)
            TransactionManager.Instance.TransactionTaskDone()
            newViews.append(newView)
        
        except Exception as ex:
            warning.append(str(ex))
            
    if len(newViews) > 1:
        newViews.sort(key=lambda v: v.get_Parameter(BuiltInParameter.VIEW_NAME).AsString())
        
        
    OUT = newViews

else:
    OUT = "Toggle is off"
# ----------------------------------------

# group: Output
join = List.Join(list0=inserir_vt_e_renomear_vista, list1=view3d_by_boundingbox)
python_script = Python(IN[0]=join)  # IronPython2
# ---------- python_script.python (55 lines) ----------
import clr
clr.AddReference("RevitAPI")
clr.AddReference("RevitAPIUI")
clr.AddReference("RevitServices")
clr.AddReference("RevitNodes")

from Autodesk.Revit.DB import *
from Autodesk.Revit.UI import *
from RevitServices.Persistence import DocumentManager
from RevitServices.Transactions import TransactionManager
from Revit.Elements import Element

# Obtém o documento ativo do Revit
doc = DocumentManager.Instance.CurrentDBDocument

# Função para categorizar vistas em 2D e 3D
def categorizar_vistas(vistas):
    vistas_2d = []
    vistas_3d = []

    for vista in vistas:
        if isinstance(vista, ViewPlan):
            vistas_2d.append(vista)
        elif isinstance(vista, View3D):
            vistas_3d.append(vista)
    
    return vistas_2d, vistas_3d

# Função para formatar a lista de vistas
def formatar_lista_vistas(vistas, tipo):
    resultado = "{}:\n".format(tipo)
    for vista in vistas:
        resultado += "- {}\n".format(vista.Name)
    return resultado

# Entrada do Dynamo
vistas_input = UnwrapElement(IN[0])

# Categoriza as vistas
vistas_2d, vistas_3d = categorizar_vistas(vistas_input)

# Formata as listas de vistas
lista_vistas_2d = formatar_lista_vistas(vistas_2d, "Vistas 2D") if vistas_2d else ""
lista_vistas_3d = formatar_lista_vistas(vistas_3d, "Vistas 3D") if vistas_3d else ""

# Concatena as listas
resultado_final = "Vistas criadas:\n\n" + lista_vistas_2d + "\n" + lista_vistas_3d

# Exibe a mensagem para o usuário
if resultado_final.strip():
    TaskDialog.Show("Vistas Criadas", resultado_final)
else:
    TaskDialog.Show("Vistas Criadas", "Nenhuma vista foi criada.")

OUT = resultado_final
# ----------------------------------------

verificar_se_o_parâmetro_existe = Python(IN[0]=formulário_inicial, IN[1]=parâmetro)  # IronPython2
# ---------- verificar_se_o_parâmetro_existe.python (41 lines) ----------
import clr
clr.AddReference('RevitAPI')
clr.AddReference('RevitAPIUI')
clr.AddReference('RevitServices')
from Autodesk.Revit.DB import *
from RevitServices.Persistence import DocumentManager
from RevitServices.Transactions import TransactionManager
from Autodesk.Revit.UI import TaskDialog

# Coletando o documento atual
doc = DocumentManager.Instance.CurrentDBDocument

# Função para verificar a existência do parâmetro e sua associação com a categoria
def check_parameter_and_category(parameter_name):
    # Obtendo os parâmetros do projeto
    parameters = doc.ParameterBindings
    it = parameters.ForwardIterator()
    it.Reset()
    while it.MoveNext():
        definition = it.Key
        binding = it.Current
        
        if definition.Name == parameter_name:
            # Verificar se a categoria associada é a especificada
            if isinstance(binding, ElementBinding):
                categories = binding.Categories
                for cat in categories:
                    if cat.Id == ElementId(BuiltInCategory.OST_DetailComponents):
                        return True
    return False

# Verificar se o parâmetro 'p.NÚMERO.DETALHE' existe
parameter_name = IN[1]
parameter_exists = check_parameter_and_category(parameter_name)

# Exibir TaskDialog se o parâmetro não existir
if not parameter_exists:
    TaskDialog.Show("Parâmetro Não Encontrado", "Necessário criar o parâmetro p.NÚMERO.DETALHE no projeto atual.")

# Saída do script
OUT = parameter_exists
# ----------------------------------------
verificar_se_o_pacote_foi = Python(IN[0]=duplicate)  # "Verificar se o pacote foi instalado"; IronPython2
# ---------- verificar_se_o_pacote_foi.python (17 lines) ----------
import clr
clr.AddReference('RevitAPI')
clr.AddReference('RevitAPIUI')
clr.AddReference('RevitServices')
from Autodesk.Revit.DB import *
from RevitServices.Persistence import DocumentManager
from RevitServices.Transactions import TransactionManager
from Autodesk.Revit.UI import TaskDialog

# Coletando o documento atual
check = IN[0]

if check==None:
	TaskDialog.Show("Aviso","Necessário instalar o pacote archilab no Dynamo. Por favor, consulte o tutorial.")

# Saída do script
OUT = check
# ----------------------------------------
