# Dynamo graph Avisos_script.dyn (Dynamo 2.16.2.5624)

python_script = Python()  # IronPython2; unwired: IN[0]
# ---------- python_script.python (16 lines) ----------
import clr
clr.AddReference("RevitAPI")
clr.AddReference("RevitAPIUI")
clr.AddReference("RevitServices")
clr.AddReference("RevitNodes")

from Autodesk.Revit.DB import *
from Autodesk.Revit.UI import *
from RevitServices.Persistence import DocumentManager
from RevitServices.Transactions import TransactionManager
from Revit.Elements import Element

# Obtém o documento ativo do Revit
doc = DocumentManager.Instance.CurrentDBDocument

OUT = TaskDialog.Show("Aviso","Versão: 1.0 \nAssista aos vídeos tutoriais para correto funcionamento do plugin. \nSolicite suporte em caso de dúvidas ou erros.")
# ----------------------------------------
