# Dynamo graph Install_script.dyn (Dynamo 2.16.2.5624)
# packages: archi-lab.net 2024.217.1024

# note: Pacote archilab
duplicate = archilab.Revit.Views.Views.Duplicate()  # unwired: view, options
# note: IronPython2.7
python_script = Python()  # IronPython2; unwired: IN[0]; starter script, not edited (OUT = 0)
python_script_2 = Python(IN[0]=duplicate, IN[1]=python_script)  # IronPython2
# ---------- python_script_2.python (17 lines) ----------
import clr
clr.AddReference("RevitAPI")
clr.AddReference("RevitAPIUI")
clr.AddReference("RevitServices")
clr.AddReference("RevitNodes")

from Autodesk.Revit.DB import *
from Autodesk.Revit.UI import *
from RevitServices.Persistence import DocumentManager
from RevitServices.Transactions import TransactionManager
from Revit.Elements import Element

# Obtém o documento ativo do Revit
doc = DocumentManager.Instance.CurrentDBDocument

if IN[0] and IN[1] !=None:
	OUT = TaskDialog.Show("Aviso","Todos os pacotes já estão instalados.")
# ----------------------------------------
