# Dynamo graph Tags de prumadas-R01_script.dyn (Dynamo 2.16.2.5624)

# group: CAMPOS PERSONALIZÁVEIS
# Nome da Tag - Prumadas
# note: Altere estes campos caso o nome da família da TAG principal de prumadas seja alterada.
# Desta forma, essa família sempre aparecerá em primeiro na lista de tags.
primeira_tag = StringInput("TAG-PRUMADAS")

obtém_as_prumadas_e_links = Python(IN[0]=primeira_tag)  # IronPython2
# ---------- obtém_as_prumadas_e_links.python (236 lines) ----------
import clr
import sys
import System
from System.Collections.Generic import *

clr.AddReference('ProtoGeometry')
from Autodesk.DesignScript.Geometry import *

clr.AddReference("RevitServices")
import RevitServices
from RevitServices.Persistence import DocumentManager
from RevitServices.Transactions import TransactionManager

clr.AddReference('RevitAPI')
clr.AddReference('RevitAPIUI')
import Autodesk 
from Autodesk.Revit.DB import *  
from Autodesk.Revit.UI import *
from Autodesk.Revit.UI.Selection import *

from collections import defaultdict
 
# Obtenha o documento ativo e a instância do aplicativo
doc = DocumentManager.Instance.CurrentDBDocument
uidoc = DocumentManager.Instance.CurrentUIApplication.ActiveUIDocument

# Classe para o formulário de seleção de elementos
clr.AddReference('System.Windows.Forms')
clr.AddReference('System.Drawing')

from System.Windows.Forms import Application, Form, ComboBox, Label, Button, ComboBoxStyle, FormStartPosition, AnchorStyles
from System.Drawing import Point, Size, Color

first_tag = IN[0]

class MyForm(Form):
    def __init__(self):
        self.Text = "Formulário Customizado"
        self.Size = Size(340, 350)  # Ajuste o tamanho do formulário para acomodar o novo campo
        self.StartPosition = FormStartPosition.CenterScreen
        self.MaximizeBox = False
        self.MinimizeBox = False
        self.ShowIcon = False

        # Configuração do tema Dark
        self.BackColor = Color.FromArgb(45, 45, 48)
        self.ForeColor = Color.White

        # Label e DropDownList para Família da Tag
        self.label_tag_family = Label()
        self.label_tag_family.Text = "Família da Tag"
        self.label_tag_family.Location = Point(20, 20)
        self.Controls.Add(self.label_tag_family)

        self.dropdown_tag_family = ComboBox()
        self.dropdown_tag_family.Location = Point(140, 20)
        self.dropdown_tag_family.Size = Size(150, 30)
        self.dropdown_tag_family.DropDownStyle = ComboBoxStyle.DropDownList
        self.Controls.Add(self.dropdown_tag_family)

        # Preencher a DropDownList com os nomes das Tags de Tubos
        self.populate_tag_families()

        # Label e DropDownList para orientação
        self.label_orientation = Label()
        self.label_orientation.Text = "Orientação da Tag"
        self.label_orientation.Location = Point(20, 70)
        self.Controls.Add(self.label_orientation) 

        self.dropdown_orientation = ComboBox()
        self.dropdown_orientation.Items.Add("Horizontal")
        self.dropdown_orientation.Items.Add("Vertical")
        self.dropdown_orientation.SelectedIndex = 1
        self.dropdown_orientation.Location = Point(140, 70)
        self.dropdown_orientation.Size = Size(150, 30)
        self.dropdown_orientation.DropDownStyle = ComboBoxStyle.DropDownList
        self.Controls.Add(self.dropdown_orientation)

        # Botão de seleção de elementos de vínculos
        self.btn_select_element = Button()
        self.btn_select_element.Text = "Selecione os elementos"
        self.btn_select_element.BackColor = Color.Red
        self.btn_select_element.ForeColor = Color.White
        self.btn_select_element.Size = Size(200, 40)
        self.btn_select_element.Location = Point((self.ClientSize.Width - self.btn_select_element.Width) // 2, 120)
        self.btn_select_element.Anchor = AnchorStyles.Top
        self.btn_select_element.Click += self.on_select_elements
        self.Controls.Add(self.btn_select_element)

        # Botão OK
        self.btn_ok = Button()
        self.btn_ok.Text = "OK"
        self.btn_ok.Location = Point(130, 180)
        self.btn_ok.Click += self.on_ok
        self.Controls.Add(self.btn_ok)
        
        # Informação da empresa
        self.company_info = Label()
        self.company_info.Text = 'Versão 1.0\nBIM Coder | Première Engenharia\nBy: Fellipe Caetano\nIG: @bimcoder YT: _bimcoder\ncontato@bimcoder.net'
        self.company_info.Location = Point(10, 230)
        self.company_info.Size = Size(280, 80)
        self.company_info.ForeColor = Color.White  # Cor do texto branca
        self.Controls.Add(self.company_info)

        # Variável para armazenar os elementos selecionados
        self.selected_elements = []
        self.orientation = None

    def populate_tag_families(self):
        self.dropdown_tag_family.Items.Clear()
        
        # Obter as famílias de tags de tubos
        collector = FilteredElementCollector(doc).OfCategory(BuiltInCategory.OST_PipeTags).OfClass(FamilySymbol)
        tag_families = sorted(set(symbol.Family.Name for symbol in collector))

        # Colocar "TAG-PRUMADAS" como o primeiro item, se existir
        if "TAG-PRUMADAS" in tag_families:
            self.dropdown_tag_family.Items.Add(first_tag)
            tag_families.remove(first_tag)

        for family in tag_families:
            self.dropdown_tag_family.Items.Add(family)

        # Definir o primeiro item selecionado como "TAG-PRUMADAS"
        self.dropdown_tag_family.SelectedIndex = 0

    def on_select_elements(self, sender, event):
        self.Hide()
        try:
            references = uidoc.Selection.PickObjects(ObjectType.LinkedElement, "Selecione os elementos do vínculo")
            self.selected_elements = references

            if self.selected_elements:
                self.btn_select_element.BackColor = Color.Green  # Change button color to green
                self.btn_select_element.Text = 'Elementos selecionados!'
                self.Show()
                self.StartPosition = FormStartPosition.CenterScreen
                self.BringToFront()
            else:
                self.selected_elements = []
                TaskDialog.Show('Aviso', 'Por favor, selecione elementos válidos!')
                self.Show()
                self.StartPosition = FormStartPosition.CenterScreen
                self.BringToFront()
        except Exception as e:
            self.selected_elements = []
            TaskDialog.Show('Erro', str(e))
            self.Show()
            self.StartPosition = FormStartPosition.CenterScreen
            self.BringToFront()

    def on_ok(self, sender, event):
        if not self.selected_elements:
            TaskDialog.Show('Aviso', 'Por favor, selecione elementos!')
            self.Show()
            self.StartPosition = FormStartPosition.CenterScreen
            self.BringToFront()
            return
            
        global tag_family    
        
        self.orientation = self.dropdown_orientation.SelectedItem
        tag_family = self.dropdown_tag_family.SelectedItem
        self.Close()

# Função para verificar se o tubo é vertical (ou levemente inclinado no eixo Z)
def is_vertical(element, tolerance=0.01):
    location_curve = element.Location
    if hasattr(location_curve, 'Curve'):
        curve = location_curve.Curve
        start_point = curve.GetEndPoint(0)
        end_point = curve.GetEndPoint(1)
        rounded_start_x = round(start_point.X, 2)
        rounded_start_y = round(start_point.Y, 2)
        rounded_end_x = round(end_point.X, 2)
        rounded_end_y = round(end_point.Y, 2)
        return abs(rounded_start_x - rounded_end_x) <= tolerance and abs(rounded_start_y - rounded_end_y) <= tolerance
    return False

# Função para selecionar múltiplos elementos de um vínculo e filtrar apenas os tubos verticais e conduítes com p.CODIGO
def select_linked_prumadas(selected_elements):
    try:
        linked_prumadas = []

        for ref in selected_elements:
            link_instance = doc.GetElement(ref.ElementId)
            link_doc = link_instance.GetLinkDocument()
            if link_doc is not None:
                linked_element = link_doc.GetElement(ref.LinkedElementId)
                if linked_element is not None:
                    if linked_element.Category.Id.IntegerValue in [int(BuiltInCategory.OST_PipeCurves), int(BuiltInCategory.OST_Conduit)]:
                        if is_vertical(linked_element):
                            param_codigo = linked_element.LookupParameter("p.CODIGO")
                            param_sistema = linked_element.get_Parameter(BuiltInParameter.RBS_PIPING_SYSTEM_TYPE_PARAM)
                            if param_codigo and param_codigo.HasValue and param_sistema and param_sistema.HasValue:
                                codigo = param_codigo.AsString()
                                sistema = param_sistema.AsValueString()
                                linked_prumadas.append((linked_element, link_instance, sistema, codigo))

        grouped_prumadas = defaultdict(list)
        for prumada, link_instance, sistema, codigo in linked_prumadas:
            key = (sistema, codigo)
            grouped_prumadas[key].append((prumada, link_instance))

        highest_prumadas = []
        for key, prumadas in grouped_prumadas.items():
            highest_prumada = max(prumadas, key=lambda p: p[0].Location.Curve.GetEndPoint(0).Z)
            highest_prumadas.append(highest_prumada)

        prumadas_list = [prumada for prumada, _ in highest_prumadas]
        link_instances_list = [link_instance for _, link_instance in highest_prumadas]

        return prumadas_list, link_instances_list

    except Exception as e:
        return str(e)
 
# Executar o formulário
Application.EnableVisualStyles() 
form = MyForm()
Application.Run(form)

# Após o fechamento do formulário, processar a seleção
if form.selected_elements:
    prumadas_list, link_instances_list = select_linked_prumadas(form.selected_elements)

    # Determinar se os tubos estão dispostos horizontalmente ou verticalmente em planta
    if form.orientation == "Horizontal":
        prumadas_list.sort(key=lambda p: p.Location.Curve.GetEndPoint(0).X)
    else:
        prumadas_list.sort(key=lambda p: p.Location.Curve.GetEndPoint(0).Y)

    # Saída do script
    OUT = (prumadas_list, link_instances_list, form.orientation, tag_family)
else:
    OUT = ("Nenhum elemento selecionado.", [], None)
# ----------------------------------------
insere_as_tags = Python(IN[0]=obtém_as_prumadas_e_links)  # IronPython2
# ---------- insere_as_tags.python (146 lines) ----------
import clr
import sys
import System
from System.Collections.Generic import *

clr.AddReference('ProtoGeometry')
from Autodesk.DesignScript.Geometry import *

clr.AddReference("RevitServices")
import RevitServices
from RevitServices.Persistence import DocumentManager
from RevitServices.Transactions import TransactionManager

clr.AddReference('RevitAPI')
clr.AddReference('RevitAPIUI')
import Autodesk 
from Autodesk.Revit.DB import *  
from Autodesk.Revit.UI import *
from Autodesk.Revit.UI.Selection import *

# Obtenha o documento ativo e a instância do aplicativo
doc = DocumentManager.Instance.CurrentDBDocument
uidoc = DocumentManager.Instance.CurrentUIApplication.ActiveUIDocument

# Variáveis de configuração
disposicao_dos_pontos = IN[0][2]
tag_family = IN[0][3]
espacamento_vertical_escala_base_cm = 85.34
espacamento_horizontal_escala_base_cm = 133
escala_base = 100  # Escala de referência 1:100

# Função para mover a tag para o ponto desejado
def move_tag_to_point(tag, target_point):
    tag_location = tag.TagHeadPosition
    translation_vector = XYZ(target_point.X - tag_location.X, target_point.Y - tag_location.Y, target_point.Z - tag_location.Z)
    ElementTransformUtils.MoveElement(tag.Document, tag.Id, translation_vector)

# Função para inserir tags nos tubos
def TagLinkedPipe(doc, linkedPipe, linkInstance, tagTypeName, insertionPoint):
    # Obter a localização do tubo 
    location = linkedPipe.Location
    curve = location.Curve  

    # Verificar se o link está carregado 
    type = doc.GetElement(linkInstance.GetTypeId()) 
    if RevitLinkType.IsLoaded(doc, type.Id):
        # Encontrar a família de tags
        tagFamily = FilteredElementCollector(doc).OfClass(FamilySymbol).OfCategory(BuiltInCategory.OST_PipeTags).ToElements()
        tagFamily = [f for f in tagFamily if f.Family.Name == tag_family and f.get_Parameter(BuiltInParameter.SYMBOL_NAME_PARAM).AsString().replace(" ", "") == tagTypeName][0]

        tagFamily.Activate()
 
        # Criar referência 
        newRef = Reference(linkedPipe).CreateLinkReference(linkInstance)

        # Criar transação
        TransactionManager.Instance.EnsureInTransaction(doc)

        # Criar tag com leader
        newTag = IndependentTag.Create(
            doc, tagFamily.Id, doc.ActiveView.Id, newRef, True,  # Leader ativado
            TagOrientation.Horizontal, insertionPoint)

        # Mover a tag para o ponto exato clicado pelo usuário
        move_tag_to_point(newTag, insertionPoint) 

        TransactionManager.Instance.TransactionTaskDone()

        return newTag, insertionPoint

# Função para calcular os pontos de inserção considerando a orientação da vista e a escala
def calcular_pontos_de_insercao(ponto_inicial, quantidade, disposicao, espacamento_vertical_base_cm, espacamento_horizontal_base_cm, view):
    pontos = []
    view_direction = view.ViewDirection
    up_direction = view.UpDirection
    right_direction = view.RightDirection
    
    # Obter a escala da vista
    escala_view = float(view.Scale)
     
    # Calcular espaçamento relativo à escala da vista usando a escala base 1:75
    fator_escala = escala_view / escala_base
    espacamento_vertical_ft = (float(espacamento_vertical_base_cm) / 30.48) * fator_escala
    espacamento_horizontal_ft = (float(espacamento_horizontal_base_cm) / 30.48) * fator_escala
    
    for i in range(quantidade): 
        if disposicao == "Horizontal":
            deslocamento = right_direction.Multiply(i * espacamento_horizontal_ft)
        else:
            deslocamento = up_direction.Multiply(-i * espacamento_vertical_ft)
        
        novo_ponto = ponto_inicial.Add(deslocamento)
        pontos.append(novo_ponto)
        
    if disposicao == "Horizontal":
    	return pontos
    else:
   		return pontos[::-1]  # Reverter a lista de pontos para começar pelo último tubo 

# Função para obter o plano de referência da vista ativa
def obter_plano_de_referencia(view):
    if view.SketchPlane is not None:
        return view.SketchPlane.GetPlane()
    else:
        # Cria um plano na origem com a orientação da vista
        origin = XYZ(0, 0, 0)
        normal = view.ViewDirection
        plane = Plane.CreateByNormalAndOrigin(normal, origin)
        TransactionManager.Instance.EnsureInTransaction(doc)
        sketchPlane = SketchPlane.Create(doc,plane)
        view.SketchPlane = sketchPlane
        TransactionManager.Instance.TransactionTaskDone()
        return plane

# Obter o ponto inicial do usuário
view = doc.ActiveView
plano_referencia = obter_plano_de_referencia(view)
ponto_inicial = uidoc.Selection.PickPoint("Selecione o ponto inicial para disposição das tags")

# Obter os elementos selecionados e filtrados
selected_pipes = IN[0][0]
linked_instances = IN[0][1]

# Calcular os pontos de inserção com base no ponto inicial, quantidade de tubos, disposição e orientação da vista
pontos_de_insercao = calcular_pontos_de_insercao(ponto_inicial, len(selected_pipes), disposicao_dos_pontos, espacamento_vertical_escala_base_cm, espacamento_horizontal_escala_base_cm, doc.ActiveView)

# Criar tags para os tubos selecionados e armazenar as IDs das tags criadas
created_tags = []
tag_ids = []
for pipe, link_instance, insertion_point in zip(UnwrapElement(selected_pipes), UnwrapElement(linked_instances), pontos_de_insercao):
    # Obter o nome do sistema do tubo para definir o tag_type_name
    param_sistema = pipe.get_Parameter(BuiltInParameter.RBS_PIPING_SYSTEM_TYPE_PARAM)
    if param_sistema:
        tag_type_name = param_sistema.AsValueString().replace(" ", "")
    else:
        tag_type_name = "HID-ALIMENTAÇÃO"  # Nome padrão caso o parâmetro não esteja presente 
    
    tag, insertion_point = TagLinkedPipe(doc, pipe, link_instance, tag_type_name, insertion_point)
    created_tags.append(tag)
    tag_ids.append(tag.Id)
    
# Selecionar as tags criadas
uidoc.Selection.SetElementIds(List[ElementId](tag_ids))    
    
# Saída do script
OUT = created_tags
# ----------------------------------------
