# Dynamo graph Detail Number Update-R00_script.dyn "Detail Number Update - Iron Python" (Dynamo 2.16.2.5624)

python_script = Python()  # IronPython2; unwired: IN[0]
# ---------- python_script.python (56 lines) ----------
import clr
clr.AddReference('RevitServices')
import RevitServices
from RevitServices.Persistence import DocumentManager
from RevitServices.Transactions import TransactionManager

clr.AddReference('RevitAPI')
clr.AddReference('RevitAPIUI')
import Autodesk
from Autodesk.Revit.DB import *
from Autodesk.Revit.UI import *

# Obter o documento ativo
doc = DocumentManager.Instance.CurrentDBDocument

# Obter a vista ativa
active_view = doc.ActiveView

# Obter todas as viewports da prancha atual (vista ativa)
viewports = FilteredElementCollector(doc, active_view.Id).OfCategory(BuiltInCategory.OST_Viewports).ToElements()

# Lista para armazenar viewports que falharem na atribuição do número de detalhe
failed_viewports = []

# Iniciar a transação
TransactionManager.Instance.EnsureInTransaction(doc)

for viewport in viewports:
    # Obter a vista associada à viewport
    view = doc.GetElement(viewport.ViewId)
    
    # Verificar se a vista é uma vista de piso
    if view.ViewType == ViewType.FloorPlan:
        
        # Capturar os 2 últimos dígitos do nome da vista
        view_name = view.Name
        last_two_digits = view_name[-3:]
        
        
        # Atribuir ao parâmetro "Número de Detalhe"
        detail_number_param = view.get_Parameter(BuiltInParameter.VIEWPORT_DETAIL_NUMBER)
        detail_number_param.Set(last_two_digits)
            
 
# Finalizar a transação
TransactionManager.Instance.TransactionTaskDone()

# Verificar se há viewports que falharam
if failed_viewports:
    message = "Não foi possível adicionar o número de detalhe às vistas selecionadas. Confira se esse número já não está inserido em outra vista da prancha atual."
    # Exibir mensagem de erro
    TaskDialog.Show("Erro", message)
else:
    TaskDialog.Show("Aviso","Números de detalhe atualizados com sucesso!")
 
OUT = 0     
# ----------------------------------------
